# Grasshopper definition Fast_Solar_Simulator_Integration_1.9.4_NewSeries_Solaris_1.3_Simplified_Educational.gh (Grasshopper 1.0.7)
# Copyright: All rights reserved

# ---- group: Voxelator
crv = Curve(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)
panel = Panel("Voxelator")
rad = Radians(Degrees=Slider(0, range=0..180))
xy = XYPlane(Origin=Point(346.2829891, 168.4162942, 0))
Z = UnitZ(Factor=Slider(40, range=0..100))
extr = Extrude(Base=crv, Direction=Z)
cap = CapHoles(Brep=extr)
prot = RotatePlane(Plane=xy, Angle=rad)
brep = Brep(cap)
mesh = MeshBrep(
    Brep=brep,
    Settings={GridMaxCount=0, GridMinCount=16, JaggedSeams=False, MaxEdgeLength=0, MinEdgeLength=0.0001, MinTolerance=0, Refine=True, RefineAngle=0, RelativeTolerance=0.65, SimplePlanes=True, Tolerance=0})
voxelator = CSharpScript(BVol=mesh, BPlane=prot, x=Slider(2, range=0..10), y=Slider(2, range=0..10), z=Slider(3.6, range=0..10))  # -> out, A, Voxize, Voxenters, Boxels; inputs BVol: Mesh, BPlane: Plane, x: Double, y: Double, z: Double
# ---------- voxelator: C# usings ----------
using System.IO;
using System.Linq;
using System.Data;
using System.Drawing;
using System.Reflection;
using System.Windows.Forms;
using System.Xml;
using System.Xml.Linq;
using System.Runtime.InteropServices;

using Rhino.DocObjects;
using Rhino.Collections;
using GH_IO;
using GH_IO.Serialization;
# ---------- voxelator: C# ----------
    /*the algorithm has been designed based on 
    [1]	P. Nourian, R. Gonçalves, S. Zlatanova, K. A. Ohori, and A. Vu Vo, “Voxelization algorithms for geospatial applications: Computational methods for voxelating spatial datasets of 3D city models containing 3D surface, curve and point data models,” MethodsX, vol. 3, pp. 69–86, 2016.
    The code has been written by Pirouz Nourian and is licensed with 'a modified BSD 3-Clause License'
    Copyright (c) 2018, Pirouz Nourian
    All rights reserved.
    A full description of the license is privided in the git repository: https://gitlab.com/Pirouz-Nourian/spatial_computing/tree/master  
*/  

    Vector3d VoxelSize = new Vector3d(x, y, z);
    Voxize = VoxelSize;

    if(!BVol.IsClosed){throw new Exception("the bounding volume is not a closed/solid mesh; therefore this method cannot work!");}

    double epsilon = 10E-3;
    if((x < epsilon) || (y < epsilon) || (z < epsilon)){throw new Exception("either of the sizes is too tiny to work with!");}
    double tolerance = 0.1 * Math.Min(x, y);
    List<Tuple<int,int,int>> voxels = new List<Tuple<int,int,int>>();//could have been called the raster2D as a sparse matrix

    BoundingBox BBox = BVol.GetBoundingBox(BPlane);
    //B = BBox;

    int iCount = (int) Math.Round(BBox.Diagonal.X / x);
    int jCount = (int) Math.Round(BBox.Diagonal.Y / y);
    int kCount = (int) Math.Round(BBox.Diagonal.Z / z);



    double halfX = 0.5 * x;
    double halfY = 0.5 * y;
    double halfZ = 0.5 * z;
    Vector3d e_x = BPlane.XAxis;
    Vector3d e_y = BPlane.YAxis;
    Vector3d e_z = BPlane.ZAxis;

    Point3d Min = BBox.Min;
    Point3d Origin = BPlane.Origin;

    Origin = Origin + Min.X * e_x + Min.Y * e_y + Min.Z * e_z;//BPlane.PointAt(MinCorner.X, MinCorner.Y, MinCorner.Z);

    Origin.X = x * Math.Round(Origin.X / x);
    Origin.Y = y * Math.Round(Origin.Y / y);
    Origin.Z = z * Math.Round(Origin.Z / z);;
    //A = Origin;
    List<Mesh> BoxelMeshes = new List<Mesh>();
    List<Point3d> voxelPoints = new List<Point3d>();

    for(int i = 0;i < iCount;i++){
      for(int j = 0;j < jCount;j++){
        for(int k = 0;k < kCount;k++){
          Point3d voxelPoint = Origin + i * x * e_x + j * y * e_y + k * z * e_z;
          if(BVol.IsPointInside(voxelPoint, tolerance, false))
          {
            Tuple<int,int,int> voxel = Tuple.Create(i, j, k);
            voxels.Add(voxel);
            //voxelPoints.Add(voxelPoint);
            Mesh BoxelMesh = new Mesh();
            Point3d v000 = voxelPoint - halfX * e_x - halfY * e_y - halfZ * e_z;
            voxelPoints.Add(voxelPoint);
            Point3d v001 = v000 + x * e_x;
            Point3d v010 = v000 + y * e_y;
            Point3d v011 = v000 + x * e_x + y * e_y;
            Point3d v100 = v000 + z * e_z;
            Point3d v101 = v000 + x * e_x + z * e_z;
            Point3d v110 = v000 + y * e_y + z * e_z;
            Point3d v111 = v000 + x * e_x + y * e_y + z * e_z;
            Point3d[] vertices = new Point3d[]{v000,v001,v010,v011,v100,v101,v110,v111};
            BoxelMesh.Vertices.AddVertices(vertices);
            MeshFace fLeft = new MeshFace(0, 4, 6, 2);
            MeshFace fRight = new MeshFace(1, 3, 7, 5);
            MeshFace fBack = new MeshFace(0, 1, 5, 4);
            MeshFace fFront = new MeshFace(2, 6, 7, 3);
            MeshFace fBottom = new MeshFace(0, 2, 3, 1);
            MeshFace fTop = new MeshFace(4, 5, 7, 6);
            MeshFace[] faces = new MeshFace[]{fLeft,fRight,fBack,fFront,fBottom,fTop};
            BoxelMesh.Faces.AddFaces(faces);
            BoxelMeshes.Add(BoxelMesh);
          }
        }
      }
    }
    Boxels = BoxelMeshes;
    Voxenters = voxelPoints;

    //    string Description = "pixels as (i,j) tuples, array size as tuple of (int,int), pixel size x,pixelsize y, Plane, origin point";
    //    Tuple<string,List<Tuple<int,int>>,Tuple<int,int>,double, double, Point3d,Plane> Raster2D;
    //    Raster2D = Tuple.Create(Description, pixels, Tuple.Create(iCount, jCount), x, y, Origin, BPlane);
    //    Raster2DTuple = Raster2D;
    //    PixelTuples = pixels;
# ---------- end voxelator ----------
voxize = Vector(voxelator.Voxize)
boxels = Mesh(voxelator.Boxels)

# ----
year = Panel("""1
2
3
4
5
6
7
8
9
10
11
12""")

# ----
# LICENSE AGREEMENT: Modified BSD 3-Clause License
# 
# Copyright (c) 2018, Pirouz Nourian & Sama Rezvani
# All rights reserved.
# 
# Commerical or Academic use is permitted provided the work is adequately cited and attributed to the author. This work can be cited as follows:
# 
# Nourian, Pirouz, and Rezvani ,Sama, Voxelated Solar Envelope, 2018, avaiable at https://gitlab.com/Pirouz-Nourian/spatial_computing
# 
# 
# Redistribution and use in source and binary forms, with or without
# modification, are permitted provided that the following conditions are met:
# 
# * Redistributions of source code must retain the above copyright notice, this
#   list of conditions and the following disclaimer.
# 
# * Redistributions in binary form must reproduce the above copyright notice,
#   this list of conditions and the following disclaimer in the documentation
#   and/or other materials provided with the distribution.
# 
# * Neither the name of the copyright holder nor the names of its
#   contributors may be used to endorse or promote products derived from
#   this software without specific prior written permission.
# 
# THIS SOFTWARE IS PROVIDED BY THE COPYRIGHT HOLDERS AND CONTRIBUTORS "AS IS"
# AND ANY EXPRESS OR IMPLIED WARRANTIES, INCLUDING, BUT NOT LIMITED TO, THE
# IMPLIED WARRANTIES OF MERCHANTABILITY AND FITNESS FOR A PARTICULAR PURPOSE ARE
# DISCLAIMED. IN NO EVENT SHALL THE COPYRIGHT HOLDER OR CONTRIBUTORS BE LIABLE
# FOR ANY DIRECT, INDIRECT, INCIDENTAL, SPECIAL, EXEMPLARY, OR CONSEQUENTIAL
# DAMAGES (INCLUDING, BUT NOT LIMITED TO, PROCUREMENT OF SUBSTITUTE GOODS OR
# SERVICES; LOSS OF USE, DATA, OR PROFITS; OR BUSINESS INTERRUPTION) HOWEVER
# CAUSED AND ON ANY THEORY OF LIABILITY, WHETHER IN CONTRACT, STRICT LIABILITY,
# OR TORT (INCLUDING NEGLIGENCE OR OTHERWISE) ARISING IN ANY WAY OUT OF THE USE
# OF THIS SOFTWARE, EVEN IF ADVISED OF THE POSSIBILITY OF SUCH DAMAGE.
list = ValueList({"Winter": 0, "Summer": 1, "Year": 2, "Month": 3}, selected="Year")
list_2 = ValueList({"Jan": 1, "Feb": 2, "Mar": 3, "Apr": 4, "May": 5, "Jun": 6, "Jul": 7, "Aug": 8, "Sep": 9, "Oct": 10, "Nov": 11, "Dec": 12}, selected="Jan")
summer = Panel("""4
5
6
7
8
9""")
winter = Panel("""10
11
12
1
2
3""")
filter = StreamFilter(Gate=list, Stream0=winter, Stream1=summer, Stream2=year, Stream3=list_2)

solarwinhours = CSharpScript(W=Slider(3, range=0..10), h=Slider(0.5, range=0..1))  # -> out, A; inputs W: Double, h: Double
# ---------- solarwinhours: C# ----------
    double minHour = 12 - W;
    double maxHour = 12 + W;
    int n= (int) Math.Round((12 - 2 * W) / h);//HowManyMoments
    double[] hours = new double[n+1];
    for(int i = 0;i <= n;i++){
      double hour = minHour + i * (2 * W) / n;
      hours[i] = hour;
    }
    A = hours;
# ---------- end solarwinhours ----------

# ----
# Sun Simulator (after Ted Nagi's VB Code)
lat = Number(51.9244)
lon = Number(4.4777)
time_zone = Number(3.5)
day = Number(21)
yr = Number(2016)
solartimeangles = CSharpScript(yr=yr, mth=graft(filter), day=day, hrs=solarwinhours.A, tzone=time_zone, latitude=lat, longitude=lat, scaleRad=50)  # -> out, zenAng, azi, hrAngle, solarElev, eqaTime, solDec, sunPt, sunVec; inputs yr: Int32, mth: Int32, day: Int32, hrs: Double, tzone: Double, latitude: Double, longitude: Double, northAng: Double, scaleRad: Double
# ---------- solartimeangles: C# ----------
    // The Solar Position algorithm is based on National Oceanic and Atmospheric Administration's Solar Position Calculator http://www.srrb.noaa.gov/highlights/sunrise/azel.html
    //Code is ported into vb.net and integrated into Grasshopper by Ted Ngai Jan 30, 2009 www.tedngai.net
    //Translation to C# by Pirouz Nourian
    double hourAngle = 0;
    double haRad = 0;
    double csz = 0;
    double zenith = 0;
    double azDenom = 0;
    double azRad = 0;
    double azimuth = 0;
    double exoatmElevation = 0;
    double refractionCorrection = 0;
    double te = 0;
    double solarZen = 0;
    double elevation = 0;
    double coszen = 0;

    //timenow is GMT time for calculation
    double timenow = hrs - tzone;
    longitude = longitude * -1;

    double JD = calcJD(yr, mth, day);
    double T = calcTimeJulianCent(JD + timenow / 24.0);
    double R = calcSunRadVector(T);
    double alpha = calcSunRtAscension(T);
    double theta = calcSunDeclination(T);
    double Etime = calcEquationOfTime(T);
    //Dim theta As Double = calcGeomMeanLongSun(T)

    double eqTime = Etime;
    double solarDec = theta;
    double earthRadVec = R;

    double solarTimeFix = eqTime - 4.0 * longitude + 60.0 * -tzone;
    double trueSolarTime = hrs * 60 + solarTimeFix;

    if (trueSolarTime > 1440) {
      trueSolarTime -= 1440;
    }

    hourAngle = trueSolarTime / 4.0 - 180.0;
    if (hourAngle < -180) {
      hourAngle = hourAngle + 360;
    }

    haRad = degToRad(hourAngle);

    csz = Math.Sin(degToRad(latitude)) * Math.Sin(degToRad(solarDec)) + Math.Cos(degToRad(latitude)) * Math.Cos(degToRad(solarDec)) * Math.Cos(haRad);
    if (csz > 1.0) {
      csz = 1.0;
    } else if (csz < -1.0) {
      csz = -1;
    }

    zenith = radToDeg(Math.Acos(csz));
    azDenom = (Math.Cos(degToRad(latitude)) * Math.Sin(degToRad(zenith)));


    if (Math.Abs(azDenom) > 0.001) {
      azRad = ((Math.Sin(degToRad(latitude)) * Math.Cos(degToRad(zenith))) - Math.Sin(degToRad(solarDec))) / azDenom;
      if (Math.Abs(azRad) > 1.0) {
        if (azRad < 0) {
          azRad = -1.0;
        } else {
          azRad = 1.0;
        }
      }

      azimuth = 180.0 - radToDeg(Math.Acos(azRad));
      if (hourAngle > 0.0) {
        azimuth = -azimuth;
      }
    } else {
      if (latitude > 0.0) {
        azimuth = 180.0;
      } else {
        azimuth = 0.0;
      }
    }

    if (azimuth < 0.0) {
      azimuth = azimuth + 360;
    }

    exoatmElevation = 90.0 - zenith;
    if (exoatmElevation > 85.0) {
      refractionCorrection = 0.0;
    } else {
      te = Math.Tan(degToRad(exoatmElevation));
      if (exoatmElevation > 5.0) {
        refractionCorrection = 58.1 / te - 0.07 / (te * te * te) + 8.6E-05 / (te * te * te * te * te);
      } else if (exoatmElevation > -0.575) {
        refractionCorrection = 1735.0 + exoatmElevation * (-518.2 + exoatmElevation * (103.4 + exoatmElevation * (-12.79 + exoatmElevation * 0.711)));
      } else {
        refractionCorrection = -20.774 / te;
      }
      refractionCorrection = refractionCorrection / 3600.0;
    }

    solarZen = zenith - refractionCorrection;
    elevation = (Math.Floor(100 * (90.0 - solarZen))) / 100;
    if (solarZen < 108.0) {
      azimuth = (Math.Floor(100 * azimuth)) / 100;

      if (solarZen < 90.0) {
        coszen = (Math.Floor(10000.0 * (Math.Cos(degToRad(solarZen))))) / 10000.0;
      } else {
        coszen = 0.0;
      }
    }
    double ThetaAngle = degToRad(azimuth + northAng);

    zenAng = coszen;
    azi = ThetaAngle;
    hrAngle = hourAngle;
    double PhiAngle = degToRad(elevation);
    solarElev = PhiAngle;
    eqaTime = eqTime;
    solDec = solarDec;

    double x,y,z;
    Plane BasePlane = Plane.WorldXY;
    BasePlane.Rotate(Math.PI / 2, Vector3d.ZAxis);
    x = scaleRad * Math.Cos(PhiAngle) * Math.Cos(-ThetaAngle);
    y = scaleRad * Math.Cos(PhiAngle) * Math.Sin(-ThetaAngle);
    z = scaleRad * Math.Sin(PhiAngle);

    Point3d sunPoint = BasePlane.PointAt(x, y, z);
    sunPt = sunPoint;
    Vector3d sunVector = -(new Vector3d(sunPoint));
    sunVector.Unitize();
    sunVec = sunVector;
# ---------- solartimeangles: C# additional code ----------
  //Basic Functions
  //-----------------------------------------
  //Convert radian angle to degrees
  public double radToDeg(double angleRad)
  {
    return (180.0 * angleRad / Math.PI);
  }
  public double degToRad(double angleDeg)
  {
    return Math.PI * angleDeg / 180.0;
  }
  //Purpose: Julian day from calendar day
  //Arguments:
  //year : 4 digit year
  //month : January = 1
  //day : 1-31
  //Return value: The Julian day corresponding to the date
  //Note: Number is returned for start of day. Fractional days should be added later.
  public double calcJD(int yr, int mth, int day)
  {
    if (mth <= 2) {
      yr = yr - 1;
      mth = mth + 12;
    }
    double A = Math.Floor(yr / 100.0);
    double B = 2 - A + Math.Floor(A / 4.0);
    double JD = Math.Floor(365.25 * (yr + 4716)) + Math.Floor(30.6001 * (mth + 1)) + day + B - 1524.5;
    return JD;
  }
  //Purpose: convert Julian Day to centuries since J2000.0
  //Arguments: jd - the Julian Day to convert
  //Return value: the T value corresponding to the Julian Day
  public double calcTimeJulianCent(double jd)
  {
    double T = (jd - 2451545.0) / 36525.0;
    return T;
  }

  //Functions to calculate Rad Vector
  //--------------------------------
  //Purpose: calculate the Geometric Mean Longitude of the Sun
  //Arguments: t - number of Julian centuries since J2000.0
  //Return value: the Geometric Mean Longitude of the Sun in degrees
  public double calcGeomMeanLongSun(double t)
  {
    double LO = 280.46646 + t * (36000.76983 + 0.0003032 * t);
    while (LO > 360.0) {
      LO -= 360.0;
    }
    while (LO < 0.0) {
      LO += 360;
    }
    return LO;
  }
  //Purpose: calculate the Geometric Mean Anomaly of the Sun
  //Arguments: t - number of Julian centuries since J2000.0
  //Return value: the Geometric Mean Anomaly of the Sun in degrees
  public double calcGeomMeanAnomalySun(double t)
  {
    double M = 357.52911 + t * (35999.05029 - 0.0001537 * t);
    return M;
  }
  //Purpose: calculate the eccentricity of earth's orbit
  //Arguments: t - number of Julian centuries since J2000.0
  //Return value: the unitless eccentricity
  public double calcEccentricityEarthOrbit(double t)
  {
    double e = 0.016708634 - t * (4.2037E-05 + 1.267E-07 * t);
    return e;
  }
  //Purpose: calculate the equation of center for the sun
  //Arguments: t : number of Julian centuries since J2000.0
  //Return value: in degrees
  public double calcSunEqOfCenter(double t)
  {
    double m = calcGeomMeanAnomalySun(t);
    double mrad = degToRad(m);
    double sinm = Math.Sin(mrad);
    double sin2m = Math.Sin(mrad + mrad);
    double sin3m = Math.Sin(mrad + mrad + mrad);

    double C = sinm * (1.914602 - t * (0.004817 + 1.4E-05 + t)) + sin2m * (0.019993 - 0.000101 * t) + sin3m * 0.000289;
    return C;
  }
  //Purpose: calculate the true longitude of the sun
  //Arguments: t : number of Julian centuries since J2000.0
  //Return value: sun's true longitude in degrees
  public double calcSunTrueLong(double t)
  {
    double lo = calcGeomMeanLongSun(t);
    double c = calcSunEqOfCenter(t);
    double O = lo + c;
    return O;
  }
  //Purpose: calculate the true anamoly of the sun
  //Arguments: t : number of Julian centuries since J2000.0
  //Return value: sun's true anamoly in degrees
  public double calcSunTrueAnomaly(double t)
  {
    double m = calcGeomMeanAnomalySun(t);
    double c = calcSunEqOfCenter(t);
    double v = m + c;
    return v;
  }
  //Purpose: calculate the disTance to the sun in AU
  //Arguments: t : number of Julian centuries since J2000.0
  //Return value: sun radius vector in AUs
  public double calcSunRadVector(double t)
  {
    double v = calcSunTrueAnomaly(t);
    double e = calcEccentricityEarthOrbit(t);
    double R = (1.000001018 * (1 - e * e)) / (1 + e * Math.Cos(degToRad(v)));
    return R;
  }

  //Functions to calculate Ascension
  //-----------------------------------------------
  //Purpose: calculate the apparent longitude of the sun
  //Arguments: t : number of Julian centuries since J2000.0
  //Return value: sun's apparent longitude in degrees
  public double calcSunApparentLong(double t)
  {
    double o = calcSunTrueLong(t);
    double omega = 125.04 - 1934.136 * t;
    double lambda = o - 0.00569 - 0.00478 * Math.Sin(degToRad(omega));
    return lambda;
  }
  //Purpose: calculate the mean obliquity of the ecliptic
  //Arguments: t : number of Julian centuries since J2000.
  //Return value: mean obliquity in degrees
  public double calcMeanObliquityOfEcliptic(double t)
  {
    double seconds = 21.448 - t * (46.815 + t * (0.00059 - t * (0.001813)));
    double eO = 23.0 + (26.0 + (seconds / 60.0)) / 60.0;
    return eO;
  }
  //Purpose: calculate the corrected obliquity of the ecliptic
  //Arguments: t : number of Julian centuries since J2000.0
  //Return value: corrected obliquity in degrees
  public double calcObliquityCorrection(double t)
  {
    double eO = calcMeanObliquityOfEcliptic(t);
    double omega = 125.04 - 1934.136 * t;
    double e = eO + 0.00256 * Math.Cos(degToRad(omega));
    return e;
  }
  //Purpose: calculate the right ascension of the sun
  //Arguments: t : number of Julian centuries since J2000.0
  //Return value: sun's right ascension in degrees
  public double calcSunRtAscension(double t)
  {
    double e = calcObliquityCorrection(t);
    double lambda = calcSunApparentLong(t);
    double Tananum = (Math.Cos(degToRad(e)) * Math.Sin(degToRad(lambda)));
    double Tanadenom = (Math.Cos(degToRad(lambda)));
    double alpha = radToDeg(Math.Atan2(Tananum, Tanadenom));
    return alpha;
  }


  //-----------------------------------------
  //Purpose: calculate the declination of the sun
  //Arguments: t : number of Julian centuries since J2000.0
  //Return value: sun's declination in degrees
  public double calcSunDeclination(double t)
  {
    double e = calcObliquityCorrection(t);
    double lambda = calcSunApparentLong(t);
    double sint = Math.Sin(degToRad(e)) * Math.Sin(degToRad(lambda));
    double theta = radToDeg(Math.Asin(sint));
    return theta;
  }


  //------------------------------------
  //Calculate the difference between true solar time and mean solar time
  //Arguments: t : number of Julian centuries since J2000.0
  //Return value: equation of time in minutes of time
  public double calcEquationOfTime(double t)
  {
    double epsilon = calcObliquityCorrection(t);
    double lo = calcGeomMeanLongSun(t);
    double e = calcEccentricityEarthOrbit(t);
    double m = calcGeomMeanAnomalySun(t);
    double y = Math.Tan(degToRad(epsilon) / 2.0);
    y = y * y;
    double sin210 = Math.Sin(2.0 * degToRad(lo));
    double sinm = Math.Sin(degToRad(m));
    double cos210 = Math.Cos(2.0 * degToRad(lo));
    double sin410 = Math.Sin(4.0 * degToRad(lo));
    double sin2m = Math.Sin(2.0 * degToRad(m));

    double Etime = y * sin210 - 2.0 * e * sinm + 4.0 * e * y * sinm * cos210 - 0.5 * y * y * sin410 - 1.25 * e * e * sin2m;
    return radToDeg(Etime) * 4.0;
  }


  //----------------------------------------
  //Return the hour angle for the given location, decl, and time of day
  public double calcHourAngle(double time, double longitude, double eqtime)
  {
    return 15.0 * (time - (longitude / 15.0) - (eqtime / 60.0));
  }
# ---------- end solartimeangles ----------
vdis = VectorDisplay(Anchor=solartimeangles.sunPt, Vector=solartimeangles.sunVec)
vec = Vector(flatten(solartimeangles.sunVec))

# ----
# Sample Point Cloud representing neighbours
# You can instead use the point cloud in the scene to represent the facade points of neighbours. The current set of points are place holders to study the functionality of the algorithm.
points = Point([Point(-43.46817398, 27.47650146, 0), Point(-43.46817398, 27.47650146, 3.875), Point(-43.46817398, 27.47650146, 7.75), Point(-43.46817398, 27.47650146, 11.625), Point(-43.46817398, 27.47650146, 15.5), Point(-43.46817398, 27.47650146, 19.375)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])
normals = Vector([Vector(0, -1, 0), Vector(0, -1, 0), Vector(0, -1, 0), Vector(0, -1, 0), Vector(0, -1, 0), Vector(0, -1, 0)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])
vdisex = VectorDisplayEx(Point=points, Vector=normals, Colour=RGB(18, 143, 252), Width=2)

mesh_2 = Mesh(boxels)
points_2 = Point(points)
percent = Number(Slider(0.0012, range=0..0.01))
sunvecs = Vector(vec)
normals_2 = Vector(normals)
solarenvelope = CSharpScript(SunVecs=sunvecs, Boxels=mesh_2, Points=points_2, Normals=normals_2, Percent=percent)  # -> out, Blockage, NonBlocking, FBoxels; inputs SunVecs: list of Vector3d, Boxels: list of Mesh, Points: list of Point3d, Normals: list of Vector3d, Percent: Double
# ---------- solarenvelope: C# ----------
        /*
  The algorithm is designed based on the following papers:

  [1] F. De Luca, “Solar Form-finding . Subtractive Solar Envelope and Integrated Solar Collection Computational Method for High-rise Bui ....,”
  Proc. 37th Annu. Conf. Assoc. Comput. Aided Des. Archit. (ACADIA 2017), no. November, pp. 212–221, 2017.

  [2] P. Nourian, R. Gonçalves, S. Zlatanova, K. A. Ohori, and A. Vu Vo,
  “Voxelization algorithms for geospatial applications: Computational methods for voxelating spatial datasets of 3D city models containing 3D surface, curve and point data models,”
  MethodsX, vol. 3, pp. 69–86, 2016.

  The code has been written by Pirouz Nourian and is licensed with 'a modified BSD 3-Clause License'
  A full description of the license is privided in the git repository: https://gitlab.com/Pirouz-Nourian/spatial_computing/tree/master
  Copyright (c) 2018, Pirouz Nourian
  All rights reserved.
*/
    int n = SunVecs.Count;
    int PointCount = Points.Count;
    int NormalCount = Normals.Count;
    int VoxelCount = Boxels.Count;
    if((Percent < 0) || (Percent > 1)){throw new Exception("the percentage tolerance provided must be a number between 0 and 1!");}
    if((PointCount < 1) || (n < 1) || (VoxelCount < 1)){throw new Exception("The number of items in some inputs is not sufficient!");}
    if(PointCount != NormalCount){throw new Exception("The number of normal vectors and points must be the same!");}

    double[] BlockedFluxes = new double[VoxelCount];
    bool[] IsNotBlocking = new bool[VoxelCount];

    int Sum = PointCount * n;//in order to relativize the blockage numbers, we divide them all by the total number of rays which could have been blocked
    List<Mesh> FilteredBoxels = new List<Mesh>();
    for(int i = 0; i < VoxelCount; i++){//foreach(Mesh Boxel in Boxels){
      Mesh Boxel = Boxels[i];
      double BlockedFlux = 0;
      foreach(Vector3d SunVec in SunVecs){
        Vector3d NSunVec = -SunVec;
        for(int k = 0;k < PointCount;k++){//foreach(Point3d Point in Points){
          Point3d Point = Points[k];
          Vector3d Normal = Normals[k];
          double PotentialFlux = Vector3d.Multiply(NSunVec, Normal);
          if(PotentialFlux > 1){throw new Exception("some sunvectors or normal vectors have a norm greater than 1!");}
          if(PotentialFlux > 0){
            Ray3d Ray = new Ray3d(Point, NSunVec);
            double RayParameter = Rhino.Geometry.Intersect.Intersection.MeshRay(Boxel, Ray);
            bool Hit = (RayParameter > 0);
            if(Hit){
              BlockedFlux = BlockedFlux + PotentialFlux;
            }
          }
        }
      }
      BlockedFlux = BlockedFlux / Sum;
      BlockedFluxes[i] = BlockedFlux;
      if(BlockedFlux < Percent){
        FilteredBoxels.Add(Boxel);
        IsNotBlocking[i] = true;
      }else{
        IsNotBlocking[i] = false;
      }
    }
    Blockage = BlockedFluxes;
    NonBlocking = IsNotBlocking;
    FBoxels = FilteredBoxels;
# ---------- end solarenvelope ----------
panel_2 = Panel("Solar Envelope")

num = Number(solarenvelope.Blockage)
bnd = Bounds(Numbers=num)
dedomain = DeconstructDomain(Domain=bnd)  # -> Start, End
gradient = Gradient(
    LowerLimit=dedomain.Start,
    UpperLimit=dedomain.End,
    Parameter=num,
    stops=[0: RGB(234, 38, 0), 0.25: RGB(234, 126, 0), 0.5: RGB(254, 244, 84), 0.75: RGB(173, 203, 249), 1: RGB(75, 107, 169)])
col = Colour(gradient)

cull = CullPattern(List=col, CullPattern=solarenvelope.NonBlocking)
col_2 = Colour(cull)
col_3 = Colour(col)
material = CreateMaterial(Diffuse=col_3, Specular=RGB(255, 255, 255), Emission=RGB(0, 0, 0), Transparency=Slider(0.8, range=0..1), Shine=0)
preview = CustomPreview(Geometry=mesh_2, Shader=material)

col_4 = Colour(col_2)
mesh_3 = Mesh(solarenvelope.FBoxels)
demesh = DeconstructMesh(Mesh=mesh_3)  # -> Vertices, Faces, Colours, Normals
lng = ListLength(List=demesh.Vertices)  # -> flatten(Length)
repeat = RepeatData(Data=graft(col_4), Length=graft(lng))  # -> simplify(Data)
mcol = MeshColours(Mesh=graft(mesh_3), Colours=repeat)  # -> flatten(Mesh)
mesh_4 = Mesh(mcol)
